# Grasshopper definition CoilCAM_CurveAndAudioDemoVessel.gh (Grasshopper 1.0.7)
# Copyright: © 2017-2022 Pierre Cuvilliers, Caitlin Mueller, Massachusetts Institute of Technology

number_slider = Slider(45, range=0..200)
crv = Curve(<curve referenced from the Rhino model>)
panel = Panel("""PATH TO PYTHON 2 ON YOUR MACHINE 
i.e. "miniconda3/envs/rhinoremote/bin/python"
""")
curveinterp = CurveInterp(mycurve=crv, nbpoints=number_slider, mode="additive")
pythonremote = PythonRemote(location=panel)
square = Square(
    amplitude=Slider(1, range=0..1),
    period=Slider(10, range=0..45),
    bumps=Slider(5, range=0..45),
    nbpoints=number_slider,
    mode="additive")
audiointerp = AudioInterp(
    wavfilepath="PATH TO WAV FILE",
    amplitude=Slider(5, range=0..10),
    nbpoints=number_slider,
    values0=square,
    mode="multiplicative")

X = Slider(0, range=-1000..1000)
Y = Slider(0, range=-1000..1000)
nbpointsinlayers = Slider(10, range=0..100)
Z = Slider(4.5, range=-20..100)
initialradius_mm = Slider(45, range=0..100)
position = ConstructPoint(XCoordinate=X, YCoordinate=Y, ZCoordinate=Z)
toolpath_unit_generator = ToolpathUnitGenerator(
    position=position,
    initialradius=initialradius_mm,
    layerheight=Slider(3, range=0..5),
    nblayers=number_slider,
    nbpointsinlayer=nbpointsinlayers,
    scaleshapingparameter=curveinterp,
    rotateshapingparameter=audiointerp)  # -> out, path

# ----
# Potterbot Config
extrusion_multiplier = Slider(1, range=0..10)
print_speed_mm_s = Slider(40, range=0..200)
layer_height_mm = Slider(3, range=0..7)
nozzle_diam_mm = Slider(6, range=0..8)
box = DomainBox(Base=PlaneXY(0, 0, 0), X="415", Y="405", Z="500")

number_slider_2 = Slider(44, range=0..100)
z0 = Slider(0, range=-20..10)
pt = ConstructPoint(XCoordinate=Slider(0, range=-1000..300), YCoordinate=Slider(0, range=-1000..300), ZCoordinate=z0)
base = Base(
    position=pt,
    nblayers=Slider(3, range=0..10),
    nbpoints=Slider(22, range=0..100),
    layerheight=layer_height_mm,
    thickness=nozzle_diam_mm,
    radius=initialradius_mm)  # -> out, path

spiralize = Spiralize(path=toolpath_unit_generator.path, layerheight=layer_height_mm)  # -> out, points
merge = Merge(Data1=flatten(base.path), Data2=flatten(spiralize.points))
center_print = CenterPrint(path=merge, domainbox=box)
g_code_generator = GCodeGenerator(path=center_print, layerheight=layer_height_mm, nozzlediameter=nozzle_diam_mm, printspeed=print_speed_mm_s)  # -> gcode, nbtubes, clayheight

# ---- group: Renders Path Preview
pline = PolyLine(Vertices=center_print, Closed=False)

# ----
panel_2 = Panel(g_code_generator.gcode)

# ---- group: Clay/tube usage
# (430mm usable clay length)
# Number of tubes
# Clay height (mm)
panel_3 = Panel(g_code_generator.nbtubes)
panel_4 = Panel(g_code_generator.clayheight)

# ==== cluster Base: The base is circular and its specific shape is defined by its nbPointInLayer.
position = ClusterInput()  # point (x, y, z) to position form center
nblayers = ClusterInput()  # number of layers in form
layerheight = ClusterInput()  # layer height, should be around half the nozzle size
nbpoints = ClusterInput()  # number of points per layer
thickness = ClusterInput()  # layer thickness, should be around the nozzle size used to print
radius = ClusterInput()  # the radius of the base
base = GhPythonScript(position=position, nbLayers=nblayers, nbPoints=nbpoints, layerHeight=layerheight, thickness=thickness, radius=radius)  # -> out, path; inputs position: Point3d, nbLayers: Int32, nbPoints: Int32
# ---------- base: Python ----------
__author__ = "sami_"
__version__ = "2022.08.08"

import rhinoscriptsyntax as rs
import math
import Rhino
from System import *
from Rhino import *
from Rhino.DocObjects import *
from Rhino.Geometry import *
from Rhino.Input import *
from Rhino.Input.Custom import *
from Rhino.Commands import *
from scriptcontext import doc

path = []
curves = []
contour = []
#p0 = rs.CurveStartPoint(curve)
#radius = p0.X
currentHeight = position.Z

#vectors = []
for j in range(0, nbLayers):
    contour = []
    if j != 1:
        for i in range(0, nbPoints):
            angle = 360/nbPoints
            #print(scaleFunction[j])
            #path.append(rs.CreatePoint(position.X+(radius+scaleFunction[j]+radiusFunction[i])*math.cos(i*angle*math.pi/180 + rotateFunction[j]*math.pi/180)+translateFunction[j].X, position.Y+(radius + scaleFunction[j] + +radiusFunction[i])*math.sin(i*angle*math.pi/180+rotateFunction[j]*math.pi/180)+translateFunction[j].Y, position.Z+layerHeight*j)) #*layerHeight/nbPoints
            path.append(rs.CreatePoint(position.X+radius*math.cos(i*angle*math.pi/180), position.Y+radius*math.sin(i*angle*math.pi/180), position.Z+layerHeight*j)) #*layerHeight/nbPoints
            contour.append(rs.CreatePoint(path[len(path) - 1].X-position.X, path[len(path) - 1].Y-position.Y, 0))
            #contour.append(path[len(path) - 1])
            #vectors.append(rs.VectorUnitize(rs.VectorCreate(rs.CreatePoint(0,0,0), rs.CreatePoint(math.cos(i*angle*math.pi/180), math.sin(i*angle*math.pi/180), 0))))
        path.append(path[len(path) - nbPoints] )
        contour.append(rs.CreatePoint(path[len(path) - 1].X-position.X, path[len(path) - 1].Y-position.Y, 0))
        #contour.append(path[len(path) - 1])
    
    if j % 2 == 0:
        a = rs.AddPolyline(contour)
        centroid = rs.CurveAreaCentroid(a)
        centroid = centroid[0]
        #centroid = position
        print(centroid)
        c = rs.CurveClosestPoint(a, centroid)
        point = rs.EvaluateCurve(a, c)
        g = rs.VectorAdd(point, -centroid)
        print(g)
        #center = rs.CreatePoint(centroid.X, centroid.Y, 0)
        d = rs.VectorLength(g)
        div = d / thickness
        srf = rs.AddPlanarSrf([a])
        plane = rs.CurvePlane(a)
        crv= rs.coercecurve(a)
        St = Rhino.Geometry.CurveOffsetCornerStyle.Sharp
        center = rs.AddPoint(position.X,position.Y,0)
        
        for i in range(1,int(div)):
            #series.append(i*thickness)
            #print(i*thickness)
            #print(centroid)
            #print(rs.CurvePoints(a)[0])
            #print(i)
            #curveOff = rs.OffsetCurve(a,center,-0.001, normal=None, style=1)
            scaleRatio = (radius - i*thickness)/radius
            """curve0 = rs.ScaleObject(a, center, (scaleRatio, scaleRatio, 0), True)
            curve = rs.MoveObject(curve0, rs.AddPoint(0,0,currentHeight))"""
            #b = rs.AddCurve(a)
            #curve = rs.coercecurve(b)
            #curve[0].Scale(i*thickness/radius)
            #print()
            curve = crv.Offset(plane, -0.001, 0.01, St)
            
            curve[0].Scale(scaleRatio)
            curve[0].Translate(position.X,position.Y,currentHeight)
            #curve = crv.OffsetOnSurface(rs.coercesurface(srf), i*thickness, 100)
            #print(curve)
            #print(len(curve))
            #ccurve = rs.AddCurve(curve[0])
            curves.append(curve[0])
            #for p in rs.CurvePoints(ccurve):
            if curve != None:
                #for p in rs.CurvePoints(curve):
                for p in range(0, nbPoints):
                    path.append(curve[0].PointAt(p))
            else:
                #print(-i*thickness)
                print()
    else:
        pp1 = rs.CreatePoint(path[0].X - position.X, path[0].Y-position.X, path[0].Z)
        pp2 = rs.CreatePoint(path[0].X-2*radius - position.X, path[0].Y-position.X, path[0].Z)
        srf = rs.AddPlanarSrf([a])
        geo = rs.coercegeometry(srf)
        path2 = []
        contours = Brep.CreateContourCurves(geo, pp1, pp2, thickness)
        switch = True
        for cc in contours:
            start = cc.PointAtNormalizedLength(0)
            end = cc.PointAtNormalizedLength(1)
            if switch:
                path.append(rs.CreatePoint(start.X + position.X, start.Y + position.Y, start.Z + currentHeight))
                path.append(rs.CreatePoint(end.X + position.X, end.Y + position.Y, end.Z + currentHeight))
                switch = False
            else:
                path.append(rs.CreatePoint(end.X+ position.X, end.Y+ position.Y, end.Z + currentHeight))
                path.append(rs.CreatePoint(start.X+ position.X, start.Y+ position.Y, start.Z + currentHeight))
                switch = True
    currentHeight += layerHeight


"""path1 = []
a = rs.AddPolyline(path)
centroid = rs.CurveAreaCentroid(a)
centroid = centroid[0]
print(centroid)
c = rs.CurveClosestPoint(a, centroid)
point = rs.EvaluateCurve(a, c)
g = rs.VectorAdd(point, -centroid)
d = rs.VectorLength(g)
div = d / thickness
srf = rs.AddPlanarSrf([a])

for i in range(1,int(div)):
    #series.append(i*thickness)
    #print(i*thickness)
    #print(centroid)
    #print(rs.CurvePoints(a)[0])
    #print(i)
    curve = rs.OffsetCurve(a,centroid,i*thickness)
    curves.append(rs.coercecurve(curve))
    for p in rs.CurvePoints(curve):
        path1.append(p)
    #curves.append(curve)
    #curve = rs.OffsetCurve(a, 
#curves = rs.OffsetCurve(a,centroid,thickness)
"""

"""pp1 = path[0]
pp2 = rs.CreatePoint(path[0].X-2*radius, path[0].Y, path[0].Z)
srf = rs.AddPlanarSrf([a])
geo = rs.coercegeometry(srf)
path2 = []
contours = Brep.CreateContourCurves(geo, pp1, pp2, thickness)
switch = True
for cc in contours:
    start = cc.PointAtNormalizedLength(0)
    end = cc.PointAtNormalizedLength(1)
    if switch:
        path2.append(rs.CreatePoint(start.X, start.Y, start.Z + layerHeight))
        path2.append(rs.CreatePoint(end.X, end.Y, end.Z + layerHeight))
        switch = False
    else:
        path2.append(rs.CreatePoint(end.X, end.Y, end.Z + layerHeight))
        path2.append(rs.CreatePoint(start.X, start.Y, start.Z + layerHeight))
        switch = True"""
# ---------- end base ----------
path = ClusterOutput(base.path)  # ordered array of points (point3d)
out = ClusterOutput(base.out)  # console output

# ==== cluster ToolpathUnitGenerator: generates toolpath from shaping parameters
scalingradiusshapingparameter = ClusterInput()  # (optional) shaping parameter applies a 1D function to each layer scaling the radius of the given layer with respect to its layer index, creating the effect of varied strengths of radius shaping along the profile of the form
scaleshapingparameter = ClusterInput()  # (optional) shaping parameter applies a 1D function to the scale of all layers, modifying the profile of the form
radiusshapingparameter = ClusterInput()  # (optional) shaping parameter applies a 1D function to points in a layer, modifying the perimeter of the layer
translateshapingparameter = ClusterInput()  # (optional) shaping parameter applies a 2D function to the position of all layers, modifying the layer offsets in the xy plane
nbpointsinlayer = ClusterInput()  # number of points per layer
rotateshapingparameter = ClusterInput()  # (optional) shaping parameter applies a 1D function to the rotation of all layers, modifying the angle of the layer
position = ClusterInput()  # point (x, y, z) to position form center
initialradius = ClusterInput()  # radius of base form
nblayers = ClusterInput()  # number of layers in form
layerheight = ClusterInput()  # layer height, should be around half the nozzle size
toolpath_unit_generator = GhPythonScript(
    position=position,
    initialRadius=initialradius,
    layerHeight=layerheight,
    nbLayers=nblayers,
    nbPointsInLayer=nbpointsinlayer,
    radiusShapingParameter=radiusshapingparameter,
    scalingRadiusShapingParameter=scalingradiusshapingparameter,
    scaleShapingParameter=scaleshapingparameter,
    translateShapingParameter=translateshapingparameter,
    rotateShapingParameter=rotateshapingparameter)  # -> out, path; inputs position: Point3d, nbLayers: Int32, nbPointsInLayer: Int32, radiusShapingParameter: list, scalingRadiusShapingParameter: list, scaleShapingParameter: list, translateShapingParameter: list of Point3d, rotateShapingParameter: list
# ---------- toolpath_unit_generator: Python ----------
__author__ = "sami_"
__version__ = "2022.06.29"

import rhinoscriptsyntax as rs
import math

path = []
nbPoints = nbPointsInLayer 
radius = initialRadius

# check if shaping parameters are empty
radsp = []
for i in range(0, nbPoints):
    if radiusShapingParameter == []:
        radsp.append(0)
    else:
        radsp.append(radiusShapingParameter[i])

ssp = []
rsp = []
tsp = []
srsp = []
for j in range(0, nbLayers):
    if scaleShapingParameter == []:
        ssp.append(0)
    else:
        ssp.append(scaleShapingParameter[j])
        
    if rotateShapingParameter == []:
        rsp.append(0)
    else:
        rsp.append(rotateShapingParameter[j])
        
    if translateShapingParameter == []:
        tsp.append(rs.CreatePoint(0,0,0))
    else:
        tsp.append(translateShapingParameter[j])

if scalingRadiusShapingParameter == []:
    #print(scalingRadius)
    for j in range(0, nbLayers):
        srsp.append(1)
else:
    for j in range(0, nbLayers):
        srsp.append(scalingRadiusShapingParameter[j])


vectors = []
for j in range(0, nbLayers):
    for i in range(0, nbPoints):
        angle = 360/nbPoints
        path.append(rs.CreatePoint(position.X + (radius+srsp[j]*radsp[i]+ssp[j])*math.cos(i*angle*math.pi/180 + rsp[j]*math.pi/180) + tsp[j].X, position.Y + (radius + srsp[j]*radsp[i] + ssp[j] )*math.sin(i*angle*math.pi/180 + rsp[j]*math.pi/180) + tsp[j].Y, position.Z+layerHeight*j))
        #path.append(rs.CreatePoint(position.X + (radius+radsp[i]+ssp[j])*math.cos(i*angle*math.pi/180 + rsp[j]*math.pi/180) + tsp[j].X, position.Y + (radius + radsp[i] + ssp[j] )*math.sin(i*angle*math.pi/180 + rsp[j]*math.pi/180) + tsp[j].Y, position.Z+layerHeight*j))
# ---------- end toolpath_unit_generator ----------
out = ClusterOutput(toolpath_unit_generator.out)  # console output
path = ClusterOutput(toolpath_unit_generator.path)  # ordered array of points (point3d)

# ==== cluster Spiralize: Spiralizing the final toolpath. Should be used just before generating G-code
layerheight = ClusterInput()  # layer height, should be around half the nozzle size
path = ClusterInput()  # ordered array of points (point3d)
spiral = GhPythonScript(path=path, layerHeight=layerheight)  # -> out, points; inputs path: list of Point3d
# ---------- spiral: Python ----------
__author__ = "sami_"
__version__ = "2022.07.05"

import rhinoscriptsyntax as rs
import math

"""points= []
for j in range(0, int(len(path)/nbPoints)):
    for i in range(0, nbPoints):
        points.append(rs.CreatePoint(path[i+j*nbPoints].X, path[i+j*nbPoints].Y, path[i+j*nbPoints].Z + i*layerHeight/nbPoints))
        """
        
#index = 0
previousHeight = path[0].Z
layerNbPoints = []
print(len(path))
for i in range(0, len(path)):
    if abs(previousHeight - path[i].Z) > 0.01:
        layerNbPoints.append(i)
        #print(i)
        previousHeight = path[i].Z

points= []
index = 0
previousLayerNbPoints = 0
previousLastIndex = 0
for j in range(0, len(layerNbPoints)):
    print(j)
    for i in range(index, layerNbPoints[j]):
        print(index)
        points.append(rs.CreatePoint(path[index].X, path[index].Y, path[index].Z + (i-previousLastIndex)*layerHeight/(layerNbPoints[j] - previousLayerNbPoints)))
        print(layerNbPoints[j] - previousLayerNbPoints)
        print(path[index].Z)
        print(points[index].Z)
        index += 1
    previousLayerNbPoints = layerNbPoints[j]
    previousLastIndex = index


"""while 0 < len(path):
    
    points.append(rs.CreatePoint(path0[index].X, path0[index].Y, path0[index].Z))
    for i in range(index, len(path)):
        if (path[i].Z == points[0].Z):
            points.append(rs.CreatePoint(path[i].X, path[i].Y, path[i].Z + i*layerHeight/nbPoints))
            index += 1
        else:
            break"""
# ---------- end spiral ----------
out = ClusterOutput(spiral.out)  # console output
points = ClusterOutput(spiral.points)  # ordered array of points (point3d)

# ==== cluster CenterPrint: Move print to center of input box.
path = ClusterInput()
domainbox = ClusterInput()

# ----
# Center print on the bed
pline = PolyLine(Vertices=path, Closed=False)
box = EvaluateBox(Box=pline, UParameter="0.5", VParameter="0.5", WParameter="0")  # -> Plane, Point, Include
box_2 = EvaluateBox(Box=domainbox, UParameter="0.5", VParameter="0.5", WParameter="0")  # -> Plane, Point, Include
vec2pt = Vector2Pt(PointA=box.Point, PointB=box_2.Point, Unitize=False)  # -> Vector, Length
move = Move(Geometry=path, Motion=vec2pt.Vector)  # -> Geometry, Transform

path_2 = ClusterOutput(move.Geometry)

# ==== cluster GCodeGenerator
nozzlediameter = ClusterInput()
printspeed = ClusterInput()
path = ClusterInput()
layerheight = ClusterInput()

# ---- group: Extrusion
pline = PolyLine(Vertices=path, Closed=False)
explode = Explode(Curve=pline, Recursive=True)  # -> Segments, Vertices
len = Length(Curve=explode.Segments)
py_extrusion = GhPythonScript(LayerHeight=layerheight, NozzleWidth=nozzlediameter, SegmentLen=len)  # -> E
# ---------- py_extrusion: Python ----------
__author__ = "mert_toka"
__version__ = "2022.04.29"

import rhinoscriptsyntax as rs
import math

# input
NozzleWidth
LayerHeight
SegmentLen

# output
E = 0

E = SegmentLen*LayerHeight/NozzleWidth * (4/math.pi + LayerHeight/NozzleWidth)
#E = (4*LayerHeight*SegmentLen*ExtrusionMultiplier) / (math.pi*NozzleWidth)
# ---------- end py_extrusion ----------
ins = InsertItems(List=py_extrusion, Item="0", Indices="0", Wrap=True)
ma = MassAddition(Input=ins)  # -> Result, PartialResults

# ---- group: XYZ
pdecon = Deconstruct(Point=path)  # -> XComponent, YComponent, ZComponent

# ---- group: Feedrate
multiplication = Multiplication(A=printspeed, B="60")
merge = Merge(Data1="10000", Data2=multiplication)  # -> flatten(Result)

# ----
lastdex = LastIndex(List=ma.PartialResults)
py_adjustext = GhPythonScript(extrusions=py_extrusion)  # -> modE; inputs extrusions: list
# ---------- py_adjustext: Python ----------
__author__ = "mert_"
__version__ = "2022.10.18"

import rhinoscriptsyntax as rs

# Input
extrusions

min = 0.8
max = 1.5

# Output
modE = []

def map(value, istart, istop, ostart, ostop):
    return ostart + (ostop - ostart) * ((value - istart) / (istop - istart))

maxIdx = len(extrusions)
midIdx = maxIdx*0.5
for i, e in enumerate(extrusions):
    modE.append(e*map(i, 0, maxIdx-1, max, min))
    
#    if i < midIdx:
#        modE.append(e*map(i, 0, midIdx, max, min))
#    else:
#        modE.append(e*map(i, midIdx, maxIdx, min, max))
# ---------- end py_adjustext ----------
item = ListItem(List=ma.PartialResults, Index=lastdex, Wrap=True)
expression = Expression(x=nozzlediameter, y=item, Expression="((x/2)^2*y)/((95.5/2)^2)/430")

# ---- group: Extrusion Multiplier for correct filament thickness
expression_2 = Expression(x=nozzlediameter, Expression="(x/1.91)^2")
multiplication_2 = Multiplication(A=ma.PartialResults, B=expression_2)

# ----
multiplication_3 = Multiplication(A=expression, B=430)
p_roundgcode = GhPythonScript(f=merge, x=pdecon.XComponent, y=pdecon.YComponent, z=pdecon.ZComponent, e=multiplication_2)  # -> f, x, y, z, e
# ---------- p_roundgcode: Python ----------
__author__ = "mert_toka"
__version__ = "2022.02.02"

import rhinoscriptsyntax as rs

_x = int(x*100)/100.0
_y = int(y*100)/100.0
_z = int(z*100)/100.0
_e = int(e*10000)/10000.0
_f = int(f*100)/100.0
# ---------- end p_roundgcode ----------
nbtubes = ClusterOutput(expression)
clayheight = ClusterOutput(multiplication_3)
concat = Concatenate(
    FragmentI="G1",
    FragmentH=" F",
    FragmentJ=p_roundgcode.f,
    FragmentA=" X",
    FragmentB=p_roundgcode.x,
    FragmentC=" Y",
    FragmentD=p_roundgcode.y,
    FragmentE=" Z",
    FragmentF=p_roundgcode.z,
    FragmentG=" E",
    FragmentK=p_roundgcode.e)  # -> flatten(Result)
panel = Panel(concat)
panel_2 = Panel(""";;; === END GCODE ===
M83 ;Set to Relative Extrusion Mode
G28 Z ;Home Z
; === DEPRESSURIZE ===
G91
G91
G1 E-1300 F4000
G90
G90""")
panel_3 = Panel(""";;; START GCODE ;;;
M82 ;absolute extrusion mode
G28 ;Home
G1 X207.5 Y202.5 Z20 F10000 ;Move X and Y to center, Z to 20mm high
G1 E4000 F40000 ; !!Prime Extruder
G92 E0
G1 F30000 E-150
;;; ======""")
merge_2 = Merge(Data1=panel_3, Data2=panel, Data3=panel_2)  # -> flatten(Result)
gcode = ClusterOutput(merge_2)

# ==== cluster Square: square 1D function {y = a*0 + b if x < bumps/period, y = a*1 + b if x >= bumps/period }, x is defined by input Values0 or will take default values of integers from 0 to nbPoints
amplitude = ClusterInput()  # a, value multiplying x
period = ClusterInput()  # number of points forming one cycle
offset = ClusterInput()  # (optional) b, value added to a*{0,1}
bumps = ClusterInput()  # (optional) number of points when y != 0, which result into a protrusion
nbpoints = ClusterInput()  # number of output points (should match initialization params nbPointsInLayer for radiusShapingParameter or nbLayers for all other shaping parameters.)
values0 = ClusterInput()  # (optional) array of floats added to or multiplied by the function
mode = ClusterInput()  # (optional) ‘additive’ (default) or ‘multiplicative’ – mode determines if function operation is added to previous values or multiplied by previous values
square = GhPythonScript(amplitude=amplitude, period=period, offset=offset, bumps=bumps, nbPoints=nbpoints, values0=values0, mode=mode)  # -> values; inputs period: Int32, offset: list, bumps: Int32, nbPoints: Int32, values0: list
# ---------- square: Python ----------
__author__ = "sami_"
__version__ = "2022.06.28"

import rhinoscriptsyntax as rs
import math

values = []
nb = nbPoints

# check type of input for offset
offsets = []
for i in range(0, nb):
    if len(offset) == 0:
        offsets.append(0)
    elif len(offset) == 1:
        offsets.append(offset[0])
    else:
        offsets.append(offset[i])
        
prevValues = []
for i in range(0, nb):
    if len(values0) == 0:
        prevValues.append(0)
    elif len(values0) == 1:
        prevValues.append(values0[0])
    else:
        prevValues.append(values0[i])


for i in range(0, nbPoints):
    if mode == "additive" or mode == "":
        if bumps <= (i + offsets[i])%period:
            values.append((amplitude * 0) + prevValues[i])
        else:
            values.append((amplitude * 1) + prevValues[i])
    elif mode == "multiplicative":
        if bumps <= (i + offsets[i])%period:
            values.append((amplitude * 0) * prevValues[i])
        else:
            values.append((amplitude * 1) * prevValues[i])
# ---------- end square ----------
values = ClusterOutput(square)  # y, array of floats

# ==== cluster CurveInterp: Interprets a cruve drawn in Rhino to values which can be used in conjunction with other CoilCAM objects.
mycurve = ClusterInput()  # curve drawn in Rhino
flip = ClusterInput()  # (optional) false (default) If set to true, will rotate drawn curve around vertical axis by 180 degrees
nbpoints = ClusterInput()  # number of output points (should match initialization params nbPointsInLayer
values0 = ClusterInput()  # (optional) array of floats added to or multiplied by the function
mode = ClusterInput()  # (optional) ‘additive’ (default) or ‘multiplicative’ – mode determines if function operation is added to previous values or multiplied by previous values
curveinterp = GhPythonScript(myCurve=mycurve, flip=flip, nbPoints=nbpoints, values0=values0, mode=mode)  # -> values; inputs myCurve: Curve, flip: Boolean, nbPoints: Int32, values0: list
# ---------- curveinterp: Python ----------
__author__ = "jennihutson"

import rhinoscriptsyntax as rs

myCurvePts = rs.CurvePoints(myCurve)
origin = rs.CreatePoint(0,0,0)

sampleNumber = 100
zeroIndex = 0 

if myCurvePts[1].Y == 0:
    zeroIndex = 1
elif myCurvePts[1].Z == 0:
    zeroIndex = 2
    
startVert = myCurvePts[0]    

moveVect = origin - startVert
myCurve.Translate(moveVect)

if flip:
    if zeroIndex == 0 or zeroIndex == 1:
        rotAxis = rs.CreatePoint(0,0,1) - origin
    elif zeroIndex == 2:
        rotAxis = rs.CreatePoint(0,1,0) - origin
    myCurve.Rotate(180, rotAxis, origin)
    
newVerts = rs.DivideCurve(myCurve, nbPoints-1, False, True)
if zeroIndex == 0:
    if myCurvePts[0].Z > myCurvePts[len(myCurvePts)-1].Z:
        newVerts = [row[1] for row in reversed(newVerts)]
    else:
        newVerts = [row[1] for row in newVerts]
elif zeroIndex == 1:
    if myCurvePts[0].Z > myCurvePts[len(myCurvePts)-1].Z:
        newVerts = [row[0] for row in reversed(newVerts)]
    else:
        newVerts = [row[0] for row in newVerts]
else:
    if myCurvePts[0].Y > myCurvePts[len(myCurvePts)-1].Y:
        newVerts = [row[0] for row in reversed(newVerts)]
    else:
        newVerts = [row[0] for row in newVerts]
    
prevValues = []
for i in range(0, nbPoints):
    if len(values0) == 0:
        prevValues.append(0)
    elif len(values0) == 1:
        prevValues.append(values0[0])
    else:
        prevValues.append(values0[i])
        
values = []
for i in range(nbPoints):
    if mode == "additive" or mode == "":
        values.append(newVerts[i] + prevValues[i])
    elif mode == "multiplicative":
        values.append(newVerts[i] * prevValues[i])
# ---------- end curveinterp ----------
values = ClusterOutput(curveinterp)  # y, array of floats

# ==== cluster AudioInterp: Interpolation of an audio file as a waveform to a discrete set of values corresponding to the nbPoints
wavfilepath = ClusterInput()  # wavfilepath — path to audio file
amplitude = ClusterInput()  # number by which to multiply output values, otherwise normalized between 0-1
nbpoints = ClusterInput()  # number of output points (should match initialization params nbPointsInLayer
values0 = ClusterInput()  # (optional) array of floats added to or multiplied by the function
mode = ClusterInput()  # (optional) ‘additive’ (default) or ‘multiplicative’ – mode determines if function operation is added to previous values or multiplied by previous values
audiointerp = GhPythonScript(wavfilepath=wavfilepath, amplitude=amplitude, nbPoints=nbpoints, values0=values0, mode=mode)  # -> values; inputs nbPoints: Int32, values0: list
# ---------- audiointerp: Python ----------
__author__ = "jennihutson"

import rhinoscriptsyntax as rs
import Rhino.Geometry
import math
import scriptcontext

np = scriptcontext.sticky['numpy']
sp = scriptcontext.sticky['scipy']
spwavfile = scriptcontext.sticky['scipy.io.wavfile']
signal = scriptcontext.sticky['scipy.signal']

wavfilename = wavfilepath

samplerate, data = spwavfile.read(wavfilename)
data1 = signal.resample(data, nbPoints)
if data1.ndim > 1:
 data1 = data1[:, 0]

sampleNumber = len(data1)

myfft = np.fft.fft(data1)
freq = np.fft.fftfreq(sampleNumber)
if len(values0) == 0:
    prevValues = np.zeros(nbPoints)
else:
    prevValues = values0
    
npvalues = np.zeros_like(prevValues)


mags = abs(myfft)/(sampleNumber/2)
freqsMult = freq * 2* math.pi

dy = sampleNumber/nbPoints

for j in range(nbPoints):
    freqsByJ = freqsMult[:int(sampleNumber/2)] * j * dy #must scale j total length of wave
    sinArr = amplitude*((mags[:int(sampleNumber/2)]*np.sin(freqsByJ)))
    if mode == "additive" or mode == "":
        npvalues[j] = np.sum(sinArr) + prevValues[j]
    elif mode == "multiplicative":
        npvalues[j] = np.sum(sinArr) * prevValues[j]

values = []
for i in range(nbPoints):
    values.append(float(npvalues[i]))
# ---------- end audiointerp ----------
values = ClusterOutput(audiointerp)  # y, array of floats

# ==== cluster PythonRemote
panel = Panel("""numpy
scipy
scipy.io.wavfile
scipy.signal""")
location = ClusterInput()  # a, value multiplying x
pythonremote = GHPythonRemote(location=location, run=Toggle(True), modules=panel)  # -> out, linked_modules, rpy, import_statements
panel_2 = Panel(pythonremote.out)

# ==== cluster GHPythonRemote: Connects the Grasshopper Python component to an external Python instance.
python = PythonScript()  # -> default_working_dir
# ---------- python: Python ----------
from os import path
from Grasshopper.Folders import UserObjectFolders

cluster_comp = ghenv.Component.OnPingDocument().Owner
parent_doc_path = cluster_comp.OnPingDocument().FilePath

if parent_doc_path is not None:
    # Get path to parent GH document
    default_working_dir = path.abspath(path.dirname(parent_doc_path))
else:
    # Fallback to path to user objects default dir
    uo_folder = path.abspath(UserObjectFolders[0])
    if path.isdir(path.join(uo_folder, "gh-python-remote")):
        uo_folder = path.abspath(path.join(uo_folder, "gh-python-remote"))
    default_working_dir = uo_folder
# ---------- end python ----------
# GH to python remote example.
# ⓒ Pierre Cuvilliers, 2017-2022
# Released under the MIT license
# github.com/pilcru/ghpythonremote
# Runs and connects to an external python engine, and
# assigns imported modules to scriptcontext.sticky variables.
# 
# Arguments:
#       code (str): Path to the GH_to_python_sticky.py code file.
#       location (str): Path to a python executable, or to a folder
#             containing `python.exe`, or the name of a conda-created
#             virtual environment prefixed by `conda://` (`conda://env_name`).
#             If empty, finds python from your windows %PATH%.
#       run (boolean): Creates the connection, and imports new
#             modules, when turned to True. Kills the connection,
#             and deletes the references to the imports, when turned
#             to False.
#       modules (str list): List of module names to import in the
#             remote python. They will be added to the
#             scriptcontext.sticky dictionary, allowing them to be
#             reused from other python components in the same
#             Grasshopper document. Submodules (for example
#             `numpy.linalg` have to be added explicitly to this list
#             to be available later.
#       log_level (str from ['NOTSET', 'DEBUG', 'INFO', 'WARNING', 'ERROR', 'CRITICAL']):
#             Logging level to use for the local IronPython and the
#             remote python instance.
#       working_dir (str): Working directory for the remote python
#             instance.
# 
# Returns:
#       out (str): Console output with DEBUG information.
#       linked_modules (str list): list of imported module names.
#       rpy (rpyc connection object): The object representing the
#             remote Python interpreter.
location = ClusterInput()  # location (str): Path to a python executable, or to a folder containing `python.exe`, or the name of a conda-created virtual environment prefixed by `conda://` (`conda://env_name`). If empty, finds python from your windows %PATH%.
run = ClusterInput()  # run (boolean): Creates the connection, and imports new modules, when turned to True. Kills the connection,and deletes the references to the imports, when turned to False.
modules = ClusterInput()  # modules (str list): List of module names to import in the remote python. They will be added to the scriptcontext.sticky dictionary, allowing them to be reused from other python components in the same Grasshopper document. Submodules (for example `numpy.linalg` have to be added explicitly to this list to be available later.
list = ValueList({"CRITICAL", "ERROR", "WARNING", "INFO", "DEBUG", "NOTSET"}, selected="DEBUG")
panel = Panel(python)
ghpythonremote = GHPythonRemote(location=location, run=run, modules=modules, log_level=list, working_dir=panel)  # -> out, linked_modules, rpy; inputs run: Boolean, modules: list
# ---------- ghpythonremote: Python ----------
import inspect
import logging
from os import path
import sys
from time import sleep

import scriptcontext

import ghpythonremote
from ghpythonremote.connectors import GrasshopperToPythonRemote
from Grasshopper.Kernel.GH_RuntimeMessageLevel import Error, Warning

local_log_level = getattr(logging, log_level, logging.WARNING)
logger = logging.getLogger("ghpythonremote")
logger.setLevel(local_log_level)
ch = logging.StreamHandler()
ch.setLevel(local_log_level)
formatter = logging.Formatter("%(levelname)s: %(name)s:\n%(message)s")
ch.setFormatter(formatter)
logger.handlers = []
logger.addHandler(ch)
logger = logging.getLogger("ghpythonremote.GH_to_python")

ROOT = path.abspath(path.dirname(inspect.getfile(ghpythonremote)))
rpyc_server_py = path.join(ROOT, "pythonservice.py")

cluster_comp = ghenv.Component.OnPingDocument().Owner

# Set connection to CLOSED if this is the first run
# and initialize set of linked modules
try:
    remote_python_status
except NameError:
    remote_python_status = "CLOSED"
    lkd_modules = set()

# Wait for connection to connect or terminate
timer = 0
while remote_python_status == "CONNECTING" or remote_python_status == "CLOSING":
    sleep(1)
    timer += 1
    if timer == 10:
        try:
            gh2py_manager.__exit__(*sys.exc_info())
        except Exception:
            pass
        remote_python_status = "CLOSED"
        lkd_modules = set()
        message = (
            "Connection left in an inconsistent state and not returning. Reset "
            "everything."
        )
        if cluster_comp is not None:
            cluster_comp.AddRuntimeMessage(Warning, message)
        raise RuntimeError(message)

if run:
    if not remote_python_status == "OPEN":
        remote_python_status = "CONNECTING"
        gh2py_manager = GrasshopperToPythonRemote(
            rpyc_server_py,
            location=location,
            timeout=10,
            port=None,
            log_level=log_level,
            working_dir=working_dir,
        )
        gh2py = gh2py_manager.__enter__()
        remote_python_status = "OPEN"

    # Stuff that we can reach
    rpymod = gh2py.py_remote_modules  # A getter function for a named python module
    rpy = gh2py.connection  # Represents the remote instance root object
    scriptcontext.sticky["rpy"] = rpy
    # Add modules
    for mod in modules:
        try:
            scriptcontext.sticky[mod] = rpymod(mod)
            lkd_modules.add(mod)
        except ImportError:
            gh2py_manager.__exit__(*sys.exc_info())
            if cluster_comp is not None:
                cluster_comp.AddRuntimeMessage(
                    Error,
                    'Could not import module "{}" in remote Python.'.format(mod)
                )
            raise
        except EOFError:
            if cluster_comp is not None:
                cluster_comp.AddRuntimeMessage(
                    Error,
                    'Remote Python has been closed unexpectedly'
                )
            raise

elif not remote_python_status == "CLOSED":
    remote_python_status = "CLOSING"
    # Remove linked modules
    for mod in lkd_modules:
        del scriptcontext.sticky[mod]
    del scriptcontext.sticky["rpy"]
    gh2py_manager.__exit__(*sys.exc_info())
    lkd_modules = set()
    remote_python_status = "CLOSED"

# Change variable name because ghpython resets outputs to None before each run
linked_modules = lkd_modules

logger.info("GH to python connection is {}".format(remote_python_status))
# ---------- end ghpythonremote ----------
out = ClusterOutput(ghpythonremote.out)  # Console output.
linked_modules = ClusterOutput(ghpythonremote.linked_modules)  # Names of modules that were successfully added to the scriptcontext.sticky dictionary.
rpy = ClusterOutput(ghpythonremote.rpy)  # The object representing the remote python instance
python_2 = PythonScript(module_names=ghpythonremote.linked_modules)  # -> import_statements; inputs module_names: list
# ---------- python_2: Python ----------
import_statements = ["import scriptcontext as sc"]
for module_name in module_names:
    import_statements.append("{0} = sc.sticky['{0}']".format(module_name))

if len(module_names) == 0:
    import_statements = []
# ---------- end python_2 ----------
import_statements = ClusterOutput(python_2)  # Useful import statements to use the imported modules in your scripts.
