# Grasshopper definition CoilCAM_PBMicroExampleMug.gh (Grasshopper 1.0.7)

panel = Panel("Boolean")
panel_2 = Panel("1D")
panel_3 = Panel("2D")

# ---- group: Union
union = Union(radius=Slider(0.25, range=0..10), tolerance=Slider(0.25, range=0..2))  # -> out, path, stops, stoppoints, fillet

# ---- group: Square
period = Slider(6, range=0..100)
bumps = Slider(1, range=0..15)
square = Square(
    amplitude=Slider(2.74, range=0..300),
    period=period,
    offset=Slider(0, range=0..15),
    bumps=bumps,
    nbpoints=Slider(40, range=0..100),
    mode="additive")

# ---- group: Sinusoidal2D
amplitudex1 = Slider(0, range=-5..5)
amplitudex2 = Slider(0, range=-5..5)
periodx1 = Slider(6, range=0..100)
offset = Slider(0, range=0..100)
periodx2 = Slider(6, range=0..100)
nbpoints = Slider(120, range=0..200)
sinusoidal2d = Sinusoidal2D_2(amplitudex1=amplitudex1, periodx1=periodx1, amplitudex2=amplitudex2, periodx2=periodx2, nbpoints=nbpoints, offset=offset)

# ---- group: Sinusoidal
period_2 = Slider(70.983, range=0..100)
nbpoints_2 = Slider(60, range=1..100)
sinusoidal = Sinusoidal(amplitude=Slider(0, range=-10..20), period=period_2, offset=Slider(0, range=0..7), nbpoints=nbpoints_2, mode="additive")

# ---- group: Staircase
nbpoints_3 = Slider(120, range=0..200)
staircase = Staircase(
    stepwidth=Slider(5, range=0..20),
    stepheight=Slider(1, range=0..120),
    offset=Slider(0, range=0..100),
    nbpoints=nbpoints_3)

# ---- group: Linear
nblayers = Slider(60, range=1..100)
linear = Linear(amplitude=Slider(0, range=0..3), offset=Slider(0, range=0..100), nbpoints=nblayers, mode="additive")

# ---- group: Exponential
exponential = Exponential(
    amplitude=Slider(1, range=0..3),
    base=Slider(1, range=0..10),
    ampexp=Slider(1, range=0..10),
    offset=Slider(70, range=0..100),
    nbpoints=Slider(60, range=0..100))

# ---- group: Linear2D
amplitudex1_2 = Slider(0, range=-5..5)
offsetx1 = Slider(0, range=0..100)
amplitudex2_2 = Slider(0, range=-5..5)
offsetx2 = Slider(0, range=0..100)
nbpoints_4 = Slider(120, range=0..200)
linear2d = Linear2D_2(amplitudex1=amplitudex1_2, offsetx1=offsetx1, amplitudex2=amplitudex2_2, offsetx2=offsetx2, nbpoints=nbpoints_4)

# ----
difference = Difference()  # -> out, path
panel_4 = Panel("BASIC FUNCTIONS")

# ---- group: Linear
nblayers_2 = Slider(60, range=1..100)
linear_2 = Linear(amplitude=Slider(-0.09, range=-3..3), offset=Slider(0, range=0..100), nbpoints=nblayers_2, mode="additive")

# ---- group: Sinusoidal
nbpoints_5 = Slider(60, range=1..100)
period_3 = Slider(50, range=0..100)
sinusoidal_2 = Sinusoidal(
    amplitude=Slider(4, range=-10..20),
    period=period_3,
    offset=Slider(7, range=0..7),
    nbpoints=nbpoints_5,
    values0=linear_2,
    mode="additive")

# ----
X = Slider(0, range=-1000..1000)
Y = Slider(0, range=-1000..1000)
nblayers_3 = Slider(60, range=1..200)
nbpointsinlayers = Slider(30, range=0..100)
Z = Slider(4.5, range=-20..100)
initialradius_mm = Slider(42, range=0..50)
position = ConstructPoint(XCoordinate=X, YCoordinate=Y, ZCoordinate=Z)
toolpath_unit_generator = ToolpathUnitGenerator(
    position=position,
    initialradius=initialradius_mm,
    layerheight=Slider(1.8, range=0..5),
    nblayers=nblayers_3,
    nbpointsinlayer=nbpointsinlayers,
    scaleshapingparameter=sinusoidal_2)  # -> out, path

# ----
# Potterbot Config
extrusion_multiplier = Slider(1, range=0..10)
print_speed_mm_s = Slider(30, range=0..200)
layer_height_mm = Slider(1.8, range=0..7)
nozzle_diam_mm = Slider(5, range=0..8)
box = DomainBox(Base=PlaneXY(0, 0, 0), X="280", Y="265", Z="305")

z0 = Slider(0, range=-20..10)
pt = ConstructPoint(XCoordinate=Slider(0, range=-1000..300), YCoordinate=Slider(0, range=-1000..300), ZCoordinate=z0)
base = Base(
    position=pt,
    nblayers=Slider(3, range=0..10),
    nbpoints=Slider(22, range=0..100),
    layerheight=layer_height_mm,
    thickness=nozzle_diam_mm,
    radius=Slider(45, range=0..100))  # -> out, path

# ---- group: Sinusoidal2D
offset_2 = Slider(15.8, range=0..100)
amplitudex1_3 = Slider(9.399, range=-15..15)
periodx1_2 = Slider(50, range=0..100)
periodx2_2 = Slider(50, range=0..100)
amplitudex2_3 = Slider(2.543, range=-5..5)
panel_5 = Panel("")

# ---- group: Linear2D
offsetx2_2 = Slider(0, range=0..100)
amplitudex1_4 = Slider(0.388, range=-5..5)
offsetx1_2 = Slider(48, range=0..100)
amplitudex2_4 = Slider(0, range=-5..5)
panel_6 = Panel("")

# ---- group: Sinusoidal2D
offset_3 = Slider(12.5, range=0..100)
amplitudex1_5 = Slider(9.399, range=-15..15)
periodx1_3 = Slider(50, range=0..100)
periodx2_3 = Slider(50, range=0..100)
nbpoints_6 = Slider(120, range=0..200)
amplitudex2_5 = Slider(0, range=-5..5)

# ---- group: Linear2D
offsetx2_3 = Slider(0, range=0..100)
amplitudex1_6 = Slider(-0.251, range=-5..5)
offsetx1_3 = Slider(48, range=0..100)
amplitudex2_6 = Slider(0, range=-5..5)

# ----
X_2 = Slider(19, range=-1000..1000)
Y_2 = Slider(0, range=-1000..1000)
nbpointsinlayers_2 = Slider(30, range=0..100)
Z_2 = Slider(4.5, range=-20..100)
nblayers_4 = Slider(40, range=1..200)
initialradius_mm_2 = Slider(24.18, range=0..50)
position_2 = ConstructPoint(XCoordinate=X_2, YCoordinate=Y_2, ZCoordinate=Z_2)

# ---- group: Sinusoidal2D (continued)
sinusoidal2d_2 = Sinusoidal2D(
    amplitudex1=amplitudex1_5,
    periodx1=periodx1_3,
    amplitudex2=amplitudex2_5,
    periodx2=periodx2_3,
    nbpoints=nblayers_4,
    offset=offset_3)

# ---- group: Linear2D (continued)
linear2d_2 = Linear2D(
    amplitudex1=amplitudex1_6,
    offsetx1=offsetx1_3,
    amplitudex2=amplitudex2_6,
    offsetx2=offsetx2_3,
    nbpoints=nblayers_4,
    values0=sinusoidal2d_2)

# ----
toolpath_unit_generator_2 = ToolpathUnitGenerator(
    position=position_2,
    initialradius=initialradius_mm_2,
    layerheight=Slider(1.8, range=0..5),
    nblayers=nblayers_4,
    nbpointsinlayer=nbpointsinlayers_2,
    translateshapingparameter=linear2d_2)  # -> out, path

difference_2 = Difference(path0=toolpath_unit_generator.path, path1=toolpath_unit_generator_2.path)  # -> out, path

X_3 = Slider(-118, range=-1000..1000)
Y_3 = Slider(0, range=-1000..1000)
nbpointsinlayers_3 = Slider(30, range=0..100)
Z_3 = Slider(4.5, range=-20..100)
nblayers_5 = Slider(40, range=1..200)
initialradius_mm_3 = Slider(24.18, range=0..50)
position_3 = ConstructPoint(XCoordinate=X_3, YCoordinate=Y_3, ZCoordinate=Z_3)

sinusoidal2d_3 = Sinusoidal2D_2(
    amplitudex1=amplitudex1_3,
    periodx1=periodx1_2,
    amplitudex2=amplitudex2_3,
    periodx2=periodx2_2,
    nbpoints=nblayers_5,
    offset=offset_2,
    mode=panel_5)
linear2d_3 = Linear2D_2(
    amplitudex1=amplitudex1_4,
    offsetx1=offsetx1_2,
    amplitudex2=amplitudex2_4,
    offsetx2=offsetx2_2,
    nbpoints=nblayers_5,
    values0=sinusoidal2d_3,
    mode=panel_6)

toolpath_unit_generator_3 = ToolpathUnitGenerator(
    position=position_3,
    initialradius=initialradius_mm_3,
    layerheight=Slider(1.8, range=0..5),
    nblayers=nblayers_5,
    nbpointsinlayer=nbpointsinlayers_3,
    translateshapingparameter=linear2d_3)  # -> out, path

difference_3 = Difference(path0=difference_2.path, path1=toolpath_unit_generator_3.path)  # -> out, path
spiralize = Spiralize(path=difference_3.path, layerheight=layer_height_mm)  # -> out, points
merge = Merge(Data1=flatten(base.path), Data2=flatten(spiralize.points))
center_print = CenterPrint(path=merge, domainbox=box)
g_code_generator = GCodeGenerator(path=center_print, layerheight=layer_height_mm, nozzlediameter=nozzle_diam_mm, printspeed=print_speed_mm_s)  # -> gcode, nbtubes, clayheight

# ---- group: Renders Path Preview
pline = PolyLine(Vertices=center_print, Closed=False)

# ----
panel_7 = Panel(g_code_generator.gcode)

# ==== cluster Linear: linear 1D function y = (ax + b) +/* Values0, x is an array of integers from 0 to nbPoints
offset = ClusterInput()  # (optional) b, value added to ax
values0 = ClusterInput()  # (optional) array of floats added to or multiplied by the function
nbpoints = ClusterInput()  # number of output points (should match initialization params nbPointsInLayer for radiusShapingParameter or nbLayers for all other shaping parameters.)
mode = ClusterInput()  # (optional) ‘additive’ (default) or ‘multiplicative’ – mode determines if function operation is added to previous values or multiplied by previous values
amplitude = ClusterInput()  # a, value multiplying x
linear = GhPythonScript(amplitude=amplitude, offset=offset, nbPoints=nbpoints, values0=values0, mode=mode)  # -> values; inputs offset: list, nbPoints: Int32, values0: list
# ---------- linear: Python ----------
__author__ = "sami_"
__version__ = "2022.06.28"

import rhinoscriptsyntax as rs
import math

values = []
nb = nbPoints

# check type of input for offset and generate lists
offsets = []
for i in range(0, nb):
    if len(offset) == 0:
        offsets.append(0)
    elif len(offset) == 1:
        offsets.append(offset[0])
    else:
        offsets.append(offset[i])
        
prevValues = []
for i in range(0, nb):
    if len(values0) == 0:
        prevValues.append(0)
    elif len(values0) == 1:
        prevValues.append(values0[0])
    else:
        prevValues.append(values0[i])


"""if mode == "additive" or mode == "":
    for i in range(0, nb):
        if (len(values0) != 0):
            values.append(amplitude * i/nbLayers * values0[i])
        else:
            values.append(amplitude * i + offset)"""
            
print(prevValues)
            
for i in range(0, nb):
    if mode == "additive" or mode == "":
        values.append((amplitude * i + offsets[i]) + prevValues[i]) 
    elif mode == "multiplicative":
        values.append((amplitude * i + offsets[i]) * prevValues[i])
# ---------- end linear ----------
values = ClusterOutput(linear)  # y, array of floats

# ==== cluster Exponential: exponential 1D function y = a*m^(n*x + b) +/* Values0
base = ClusterInput()  # m, base value of the exponential
ampexp = ClusterInput()  # n, value multiplying x in the exponential
offset = ClusterInput()  # (optional) b, value added to n*x in the exponential
nbpoints = ClusterInput()  # number of output points (should match initialization params nbPointsInLayer
values0 = ClusterInput()  # (optional) array of floats added to or multiplied by the function
mode = ClusterInput()  # (optional) ‘additive’ (default) or ‘multiplicative’ – mode determines if function operation is added to previous values or multiplied by previous values
amplitude = ClusterInput()  # a, value multiplying the exponential
exponential = GhPythonScript(amplitude=amplitude, base=base, ampExp=ampexp, offset=offset, nbPoints=nbpoints, values0=values0, mode=mode)  # -> values; inputs offset: list, nbPoints: Int32, values0: list
# ---------- exponential: Python ----------
__author__ = "sami_"
__version__ = "2022.06.28"

import rhinoscriptsyntax as rs
import math

values = []
nb = nbPoints

# check type of input for offset
offsets = []
for i in range(0, nb):
    if len(offset) == 0:
        offsets.append(0)
    elif len(offset) == 1:
        offsets.append(offset[0])
    else:
        offsets.append(offset[i])
        
prevValues = []
for i in range(0, nb):
    if len(values0) == 0:
        prevValues.append(0)
    elif len(values0) == 1:
        prevValues.append(values0[0])
    else:
        prevValues.append(values0[i])

# generate the values
for i in range(0, nb):
    if mode == "additive" or mode == "":
        values.append(amplitude * math.pow(base,ampExp*i + offsets[i]) + prevValues[i])
    elif mode == "multiplicative":
        values.append(amplitude * math.pow(base,ampExp*i + offsets[i]) * prevValues[i])
# ---------- end exponential ----------
values = ClusterOutput(exponential)  # y, array of floats

# ==== cluster Square: square 1D function {y = a*0 + b if x < bumps/period, y = a*1 + b if x >= bumps/period }, x is defined by input Values0 or will take default values of integers from 0 to nbPoints
amplitude = ClusterInput()  # a, value multiplying x
period = ClusterInput()  # number of points forming one cycle
offset = ClusterInput()  # (optional) b, value added to a*{0,1}
bumps = ClusterInput()  # (optional) number of points when y != 0, which result into a protrusion
nbpoints = ClusterInput()  # number of output points (should match initialization params nbPointsInLayer for radiusShapingParameter or nbLayers for all other shaping parameters.)
values0 = ClusterInput()  # (optional) array of floats added to or multiplied by the function
mode = ClusterInput()  # (optional) ‘additive’ (default) or ‘multiplicative’ – mode determines if function operation is added to previous values or multiplied by previous values
square = GhPythonScript(amplitude=amplitude, period=period, offset=offset, bumps=bumps, nbPoints=nbpoints, values0=values0, mode=mode)  # -> values; inputs period: Int32, offset: list, bumps: Int32, nbPoints: Int32, values0: list
# ---------- square: Python ----------
__author__ = "sami_"
__version__ = "2022.06.28"

import rhinoscriptsyntax as rs
import math

values = []
nb = nbPoints

# check type of input for offset
offsets = []
for i in range(0, nb):
    if len(offset) == 0:
        offsets.append(0)
    elif len(offset) == 1:
        offsets.append(offset[0])
    else:
        offsets.append(offset[i])
        
prevValues = []
for i in range(0, nb):
    if len(values0) == 0:
        prevValues.append(0)
    elif len(values0) == 1:
        prevValues.append(values0[0])
    else:
        prevValues.append(values0[i])


for i in range(0, nbPoints):
    if mode == "additive" or mode == "":
        if bumps <= (i + offsets[i])%period:
            values.append((amplitude * 0) + prevValues[i])
        else:
            values.append((amplitude * 1) + prevValues[i])
    elif mode == "multiplicative":
        if bumps <= (i + offsets[i])%period:
            values.append((amplitude * 0) * prevValues[i])
        else:
            values.append((amplitude * 1) * prevValues[i])
# ---------- end square ----------
values = ClusterOutput(square)  # y, array of floats

# ==== cluster Sinusoidal: sine 1D function y = a*sin(2pi/T*x + b) +/* Values0, x is an array of integers from 0 to nbPoints
period = ClusterInput()  # T, number of points in one cycle
amplitude = ClusterInput()  # a, value multiplying the sinus.
offset = ClusterInput()  # (optional) b, value added to 2pi/T*x in the sinusoidal argument
nbpoints = ClusterInput()  # number of output points (should match initialization params nbPointsInLayer for radiusShapingParameter or nbLayers for all other shaping parameters.)
values0 = ClusterInput()  # (optional) array of floats added to or multiplied by the function
mode = ClusterInput()  # (optional) ‘additive’ (default) or ‘multiplicative’ – mode determines if function operation is added to previous values or multiplied by previous values
sinusoidal = GhPythonScript(amplitude=amplitude, period=period, offset=offset, nbPoints=nbpoints, values0=values0, mode=mode)  # -> values; inputs period: Int32, offset: list, nbPoints: Int32, values0: list
# ---------- sinusoidal: Python ----------
__author__ = "sami_"
__version__ = "2022.06.28"

import rhinoscriptsyntax as rs
import math

values = []
nb = nbPoints

# check type of input for offset
offsets = []
for i in range(0, nb):
    if len(offset) == 0:
        offsets.append(0)
    elif len(offset) == 1:
        offsets.append(offset[0])
    else:
        offsets.append(offset[i])
        
prevValues = []
for i in range(0, nb):
    if len(values0) == 0:
        prevValues.append(0)
    elif len(values0) == 1:
        prevValues.append(values0[0])
    else:
        prevValues.append(values0[i])

# generate the values
for i in range(0, nb):
    if mode == "additive" or mode == "":
        values.append(amplitude * math.sin(2*math.pi*i/period + offsets[i]) + prevValues[i]) 
    elif mode == "multiplicative":
        values.append(amplitude * math.sin(2*math.pi*i/period + offsets[i]) * prevValues[i])
# ---------- end sinusoidal ----------
values = ClusterOutput(sinusoidal)  # y, array of floats

# ==== cluster Staircase: staircase 1D function y= stepHeight*[x/stepWidth] + b , x is defined by input Values0 or will take default values of integers from 0 to nbPoints
stepwidth = ClusterInput()  # width of step, the amount of points before going to the next step
stepheight = ClusterInput()  # height of step, the increment of y for each new step
nbpoints = ClusterInput()  # number of output points (should match initialization params nbPointsInLayer for radiusShapingParameter or nbLayers for all other shaping parameters.)
offset = ClusterInput()  # (optional) b, value added to the step function
values0 = ClusterInput()  # (optional) array of floats used as input x in function
mode = ClusterInput()  # (optional) ‘additive’ (default) or ‘multiplicative’ – mode determines if function operation is added to previous values or multiplied by previous values
staircase = GhPythonScript(stepWidth=stepwidth, stepHeight=stepheight, offset=offset, nbPoints=nbpoints, values0=values0, mode=mode)  # -> values; inputs offset: list, nbPoints: Int32, values0: list
# ---------- staircase: Python ----------
__author__ = "sami_"
__version__ = "2022.06.28"

import rhinoscriptsyntax as rs
import math

values = []
nb = nbPoints
index = 0

# check type of input for offset
offsets = []
for i in range(0, nb):
    if len(offset) == 0:
        offsets.append(0)
    elif len(offset) == 1:
        offsets.append(offset[0])
    else:
        offsets.append(offset[i])
        
prevValues = []
for i in range(0, nb):
    if len(values0) == 0:
        prevValues.append(0)
    elif len(values0) == 1:
        prevValues.append(values0[0])
    else:
        prevValues.append(values0[i])

for i in range(0, nbPoints):
    if mode == "additive" or mode == "":
        if i % stepWidth == 0 and i != 0:
            index += stepHeight
        values.append(index + offsets[i] + prevValues[i])
    if mode == "multiplicative":
        if i % stepWidth == 0 and i != 0:
            index += stepHeight
        values.append((index + offsets[i]) * prevValues[i])
# ---------- end staircase ----------
values = ClusterOutput(staircase)  # y, array of floats

# ==== cluster Base: The base is circular and its specific shape is defined by its nbPointInLayer.
position = ClusterInput()  # point (x, y, z) to position form center
nblayers = ClusterInput()  # number of layers in form
layerheight = ClusterInput()  # layer height, should be around half the nozzle size
nbpoints = ClusterInput()  # number of points per layer
thickness = ClusterInput()  # layer thickness, should be around the nozzle size used to print
radius = ClusterInput()  # the radius of the base
base = GhPythonScript(position=position, nbLayers=nblayers, nbPoints=nbpoints, layerHeight=layerheight, thickness=thickness, radius=radius)  # -> out, path; inputs position: Point3d, nbLayers: Int32, nbPoints: Int32
# ---------- base: Python ----------
__author__ = "sami_"
__version__ = "2022.08.08"

import rhinoscriptsyntax as rs
import math
import Rhino
from System import *
from Rhino import *
from Rhino.DocObjects import *
from Rhino.Geometry import *
from Rhino.Input import *
from Rhino.Input.Custom import *
from Rhino.Commands import *
from scriptcontext import doc

path = []
curves = []
contour = []
#p0 = rs.CurveStartPoint(curve)
#radius = p0.X
currentHeight = position.Z

#vectors = []
for j in range(0, nbLayers):
    contour = []
    if j != 1:
        for i in range(0, nbPoints):
            angle = 360/nbPoints
            #print(scaleFunction[j])
            #path.append(rs.CreatePoint(position.X+(radius+scaleFunction[j]+radiusFunction[i])*math.cos(i*angle*math.pi/180 + rotateFunction[j]*math.pi/180)+translateFunction[j].X, position.Y+(radius + scaleFunction[j] + +radiusFunction[i])*math.sin(i*angle*math.pi/180+rotateFunction[j]*math.pi/180)+translateFunction[j].Y, position.Z+layerHeight*j)) #*layerHeight/nbPoints
            path.append(rs.CreatePoint(position.X+radius*math.cos(i*angle*math.pi/180), position.Y+radius*math.sin(i*angle*math.pi/180), position.Z+layerHeight*j)) #*layerHeight/nbPoints
            contour.append(rs.CreatePoint(path[len(path) - 1].X-position.X, path[len(path) - 1].Y-position.Y, 0))
            #contour.append(path[len(path) - 1])
            #vectors.append(rs.VectorUnitize(rs.VectorCreate(rs.CreatePoint(0,0,0), rs.CreatePoint(math.cos(i*angle*math.pi/180), math.sin(i*angle*math.pi/180), 0))))
        path.append(path[len(path) - nbPoints] )
        contour.append(rs.CreatePoint(path[len(path) - 1].X-position.X, path[len(path) - 1].Y-position.Y, 0))
        #contour.append(path[len(path) - 1])
    
    if j % 2 == 0:
        a = rs.AddPolyline(contour)
        centroid = rs.CurveAreaCentroid(a)
        centroid = centroid[0]
        #centroid = position
        print(centroid)
        c = rs.CurveClosestPoint(a, centroid)
        point = rs.EvaluateCurve(a, c)
        g = rs.VectorAdd(point, -centroid)
        print(g)
        #center = rs.CreatePoint(centroid.X, centroid.Y, 0)
        d = rs.VectorLength(g)
        div = d / thickness
        srf = rs.AddPlanarSrf([a])
        plane = rs.CurvePlane(a)
        crv= rs.coercecurve(a)
        St = Rhino.Geometry.CurveOffsetCornerStyle.Sharp
        center = rs.AddPoint(position.X,position.Y,0)
        
        for i in range(1,int(div)):
            #series.append(i*thickness)
            #print(i*thickness)
            #print(centroid)
            #print(rs.CurvePoints(a)[0])
            #print(i)
            #curveOff = rs.OffsetCurve(a,center,-0.001, normal=None, style=1)
            scaleRatio = (radius - i*thickness)/radius
            """curve0 = rs.ScaleObject(a, center, (scaleRatio, scaleRatio, 0), True)
            curve = rs.MoveObject(curve0, rs.AddPoint(0,0,currentHeight))"""
            #b = rs.AddCurve(a)
            #curve = rs.coercecurve(b)
            #curve[0].Scale(i*thickness/radius)
            #print()
            curve = crv.Offset(plane, -0.001, 0.01, St)
            
            curve[0].Scale(scaleRatio)
            curve[0].Translate(position.X,position.Y,currentHeight)
            #curve = crv.OffsetOnSurface(rs.coercesurface(srf), i*thickness, 100)
            #print(curve)
            #print(len(curve))
            #ccurve = rs.AddCurve(curve[0])
            curves.append(curve[0])
            #for p in rs.CurvePoints(ccurve):
            if curve != None:
                #for p in rs.CurvePoints(curve):
                for p in range(0, nbPoints):
                    path.append(curve[0].PointAt(p))
            else:
                #print(-i*thickness)
                print()
    else:
        pp1 = rs.CreatePoint(path[0].X - position.X, path[0].Y-position.X, path[0].Z)
        pp2 = rs.CreatePoint(path[0].X-2*radius - position.X, path[0].Y-position.X, path[0].Z)
        srf = rs.AddPlanarSrf([a])
        geo = rs.coercegeometry(srf)
        path2 = []
        contours = Brep.CreateContourCurves(geo, pp1, pp2, thickness)
        switch = True
        for cc in contours:
            start = cc.PointAtNormalizedLength(0)
            end = cc.PointAtNormalizedLength(1)
            if switch:
                path.append(rs.CreatePoint(start.X + position.X, start.Y + position.Y, start.Z + currentHeight))
                path.append(rs.CreatePoint(end.X + position.X, end.Y + position.Y, end.Z + currentHeight))
                switch = False
            else:
                path.append(rs.CreatePoint(end.X+ position.X, end.Y+ position.Y, end.Z + currentHeight))
                path.append(rs.CreatePoint(start.X+ position.X, start.Y+ position.Y, start.Z + currentHeight))
                switch = True
    currentHeight += layerHeight


"""path1 = []
a = rs.AddPolyline(path)
centroid = rs.CurveAreaCentroid(a)
centroid = centroid[0]
print(centroid)
c = rs.CurveClosestPoint(a, centroid)
point = rs.EvaluateCurve(a, c)
g = rs.VectorAdd(point, -centroid)
d = rs.VectorLength(g)
div = d / thickness
srf = rs.AddPlanarSrf([a])

for i in range(1,int(div)):
    #series.append(i*thickness)
    #print(i*thickness)
    #print(centroid)
    #print(rs.CurvePoints(a)[0])
    #print(i)
    curve = rs.OffsetCurve(a,centroid,i*thickness)
    curves.append(rs.coercecurve(curve))
    for p in rs.CurvePoints(curve):
        path1.append(p)
    #curves.append(curve)
    #curve = rs.OffsetCurve(a, 
#curves = rs.OffsetCurve(a,centroid,thickness)
"""

"""pp1 = path[0]
pp2 = rs.CreatePoint(path[0].X-2*radius, path[0].Y, path[0].Z)
srf = rs.AddPlanarSrf([a])
geo = rs.coercegeometry(srf)
path2 = []
contours = Brep.CreateContourCurves(geo, pp1, pp2, thickness)
switch = True
for cc in contours:
    start = cc.PointAtNormalizedLength(0)
    end = cc.PointAtNormalizedLength(1)
    if switch:
        path2.append(rs.CreatePoint(start.X, start.Y, start.Z + layerHeight))
        path2.append(rs.CreatePoint(end.X, end.Y, end.Z + layerHeight))
        switch = False
    else:
        path2.append(rs.CreatePoint(end.X, end.Y, end.Z + layerHeight))
        path2.append(rs.CreatePoint(start.X, start.Y, start.Z + layerHeight))
        switch = True"""
# ---------- end base ----------
path = ClusterOutput(base.path)  # ordered array of points (point3d)
out = ClusterOutput(base.out)  # console output

# ==== cluster ToolpathUnitGenerator: generates toolpath from shaping parameters
scalingradiusshapingparameter = ClusterInput()  # (optional) shaping parameter applies a 1D function to each layer scaling the radius of the given layer with respect to its layer index, creating the effect of varied strengths of radius shaping along the profile of the form
scaleshapingparameter = ClusterInput()  # (optional) shaping parameter applies a 1D function to the scale of all layers, modifying the profile of the form
radiusshapingparameter = ClusterInput()  # (optional) shaping parameter applies a 1D function to points in a layer, modifying the perimeter of the layer
translateshapingparameter = ClusterInput()  # (optional) shaping parameter applies a 2D function to the position of all layers, modifying the layer offsets in the xy plane
nbpointsinlayer = ClusterInput()  # number of points per layer
rotateshapingparameter = ClusterInput()  # (optional) shaping parameter applies a 1D function to the rotation of all layers, modifying the angle of the layer
position = ClusterInput()  # point (x, y, z) to position form center
initialradius = ClusterInput()  # radius of base form
nblayers = ClusterInput()  # number of layers in form
layerheight = ClusterInput()  # layer height, should be around half the nozzle size
toolpath_unit_generator = GhPythonScript(
    position=position,
    initialRadius=initialradius,
    layerHeight=layerheight,
    nbLayers=nblayers,
    nbPointsInLayer=nbpointsinlayer,
    radiusShapingParameter=radiusshapingparameter,
    scalingRadiusShapingParameter=scalingradiusshapingparameter,
    scaleShapingParameter=scaleshapingparameter,
    translateShapingParameter=translateshapingparameter,
    rotateShapingParameter=rotateshapingparameter)  # -> out, path; inputs position: Point3d, nbLayers: Int32, nbPointsInLayer: Int32, radiusShapingParameter: list, scalingRadiusShapingParameter: list, scaleShapingParameter: list, translateShapingParameter: list of Point3d, rotateShapingParameter: list
# ---------- toolpath_unit_generator: Python ----------
__author__ = "sami_"
__version__ = "2022.06.29"

import rhinoscriptsyntax as rs
import math

path = []
nbPoints = nbPointsInLayer 
radius = initialRadius

# check if shaping parameters are empty
radsp = []
for i in range(0, nbPoints):
    if radiusShapingParameter == []:
        radsp.append(0)
    else:
        radsp.append(radiusShapingParameter[i])

ssp = []
rsp = []
tsp = []
srsp = []
for j in range(0, nbLayers):
    if scaleShapingParameter == []:
        ssp.append(0)
    else:
        ssp.append(scaleShapingParameter[j])
        
    if rotateShapingParameter == []:
        rsp.append(0)
    else:
        rsp.append(rotateShapingParameter[j])
        
    if translateShapingParameter == []:
        tsp.append(rs.CreatePoint(0,0,0))
    else:
        tsp.append(translateShapingParameter[j])

if scalingRadiusShapingParameter == []:
    #print(scalingRadius)
    for j in range(0, nbLayers):
        srsp.append(1)
else:
    for j in range(0, nbLayers):
        srsp.append(scalingRadiusShapingParameter[j])


vectors = []
for j in range(0, nbLayers):
    for i in range(0, nbPoints):
        angle = 360/nbPoints
        path.append(rs.CreatePoint(position.X + (radius+srsp[j]*radsp[i]+ssp[j])*math.cos(i*angle*math.pi/180 + rsp[j]*math.pi/180) + tsp[j].X, position.Y + (radius + srsp[j]*radsp[i] + ssp[j] )*math.sin(i*angle*math.pi/180 + rsp[j]*math.pi/180) + tsp[j].Y, position.Z+layerHeight*j))
        #path.append(rs.CreatePoint(position.X + (radius+radsp[i]+ssp[j])*math.cos(i*angle*math.pi/180 + rsp[j]*math.pi/180) + tsp[j].X, position.Y + (radius + radsp[i] + ssp[j] )*math.sin(i*angle*math.pi/180 + rsp[j]*math.pi/180) + tsp[j].Y, position.Z+layerHeight*j))
# ---------- end toolpath_unit_generator ----------
out = ClusterOutput(toolpath_unit_generator.out)  # console output
path = ClusterOutput(toolpath_unit_generator.path)  # ordered array of points (point3d)

# ==== cluster Spiralize: Spiralizing the final toolpath. Should be used just before generating G-code
layerheight = ClusterInput()  # layer height, should be around half the nozzle size
path = ClusterInput()  # ordered array of points (point3d)
spiral = GhPythonScript(path=path, layerHeight=layerheight)  # -> out, points; inputs path: list of Point3d
# ---------- spiral: Python ----------
__author__ = "sami_"
__version__ = "2022.07.05"

import rhinoscriptsyntax as rs
import math

"""points= []
for j in range(0, int(len(path)/nbPoints)):
    for i in range(0, nbPoints):
        points.append(rs.CreatePoint(path[i+j*nbPoints].X, path[i+j*nbPoints].Y, path[i+j*nbPoints].Z + i*layerHeight/nbPoints))
        """
        
#index = 0
previousHeight = path[0].Z
layerNbPoints = []
print(len(path))
for i in range(0, len(path)):
    if abs(previousHeight - path[i].Z) > 0.01:
        layerNbPoints.append(i)
        #print(i)
        previousHeight = path[i].Z

points= []
index = 0
previousLayerNbPoints = 0
previousLastIndex = 0
for j in range(0, len(layerNbPoints)):
    print(j)
    for i in range(index, layerNbPoints[j]):
        print(index)
        points.append(rs.CreatePoint(path[index].X, path[index].Y, path[index].Z + (i-previousLastIndex)*layerHeight/(layerNbPoints[j] - previousLayerNbPoints)))
        print(layerNbPoints[j] - previousLayerNbPoints)
        print(path[index].Z)
        print(points[index].Z)
        index += 1
    previousLayerNbPoints = layerNbPoints[j]
    previousLastIndex = index


"""while 0 < len(path):
    
    points.append(rs.CreatePoint(path0[index].X, path0[index].Y, path0[index].Z))
    for i in range(index, len(path)):
        if (path[i].Z == points[0].Z):
            points.append(rs.CreatePoint(path[i].X, path[i].Y, path[i].Z + i*layerHeight/nbPoints))
            index += 1
        else:
            break"""
# ---------- end spiral ----------
out = ClusterOutput(spiral.out)  # console output
points = ClusterOutput(spiral.points)  # ordered array of points (point3d)

# ==== cluster Difference: The subtraction of the second input toolpath from the first input toolpath. Works only between layers of the same height and if the two paths start at the same Z
path1 = ClusterInput()  # (optional) second toolpath
path0 = ClusterInput()  # first toolpath
boolean_difference = GhPythonScript(path0=path0, path1=path1)  # -> out, path; inputs path0: list of Point3d, path1: list of Point3d
# ---------- boolean_difference: Python ----------
__author__ = "sami_"
__version__ = "2022.07.05"

import rhinoscriptsyntax as rs
import Rhino

path = []
stops = []
stopPoints = []

index0 = 0
index1 = 0

globalIndex = 0

if len(path0) != 0:
    currentHeight = path0[0].Z
    
    while index0 < len(path0) or index1 < len(path1):
        curves = []
        
        #create curve with path0 layer
        points0 = []
        if index0 < len(path0):
            points0.append(rs.CreatePoint(path0[index0].X, path0[index0].Y, path0[index0].Z))
            globalIndex += 1
            index0 += 1
            for i in range(index0, len(path0)):
                if (path0[i].Z == points0[0].Z):
                    points0.append(rs.CreatePoint(path0[i].X, path0[i].Y, path0[i].Z))
                    index0 += 1
                    globalIndex += 1
                else:
                    break
            points0.append(points0[0])
            curve0 = rs.AddPolyline(points0)
            rs.CloseCurve(curve0)
            curves.append(curve0)
        
        #create curve with path1 layer
        points1 = []
        if index1 < len(path1):
            points1.append(rs.CreatePoint(path1[index1].X, path1[index1].Y, path1[index1].Z))
            index1 += 1
            globalIndex += 1
            for i in range(index1, len(path1)):
                if (path1[i].Z == points1[0].Z):
                    points1.append(rs.CreatePoint(path1[i].X, path1[i].Y, path1[i].Z))
                    index1 += 1
                    globalIndex += 1
                else:
                    break
            points1.append(points1[0])
            curve1 = rs.AddPolyline(points1)
            rs.CloseCurve(curve1)
            curves.append(curve1)
        
        # subtract curve1 from curve0 if curve1 exists
        if len(curves) >= 2:
            newCurve = rs.CurveBooleanDifference(curves[0], curves[1])
        else:
            newCurve.append(curve0)
        
        #if the subtract worked generate the points for it and add to final path
        if len(newCurve) == 1:
            points = rs.CurvePoints(newCurve)
            for i in range(0, len(points)-1):
                path.append(rs.CreatePoint(points[i].X, points[i].Y, points[i].Z))
        #else add the points of path0 to the final path
        else:
            print("hello?")
            for i in range(0, len(points0)):
                path.append(rs.CreatePoint(points0[i].X, points0[i].Y, points0[i].Z))

            '''for i in range(0, len(points1)):
                path.append(rs.CreatePoint(points1[i].X, points1[i].Y, points1[i].Z))'''
# ---------- end boolean_difference ----------
path = ClusterOutput(boolean_difference.path)  # ordered array of points (point3d)
out = ClusterOutput(boolean_difference.out)  # console output

# ==== cluster Union: The union of the two input toolpaths. Works only between layers of the same height and if the two paths start at the same Z.
path0 = ClusterInput()  # first toolpath
path1 = ClusterInput()  # second toolpath
tolerance = ClusterInput()  # fillet tolerance
radius = ClusterInput()  # radius of the fillet curve added at the intersection between path0 and path1
boolean_union = GhPythonScript(path0=path0, path1=path1, radius=radius, tolerance=tolerance)  # -> out, path, stops, stopPoints, fillet; inputs path0: list of Point3d, path1: list of Point3d
# ---------- boolean_union: Python ----------
__author__ = "sami_"
__version__ = "2022.07.05"

import rhinoscriptsyntax as rs
import Rhino
import Rhino.Geometry as rg
import Rhino.DocObjects as rd
import scriptcontext as sc

path = []
stops = []
stopPoints = []
fillet = []

index0 = 0
index1 = 0
globalIndex = 0

if len(path0) < len(path1):
    tempPath0 = path0
    path0 = path1
    path1 = tempPath0

if len(path0) != 0:
    currentHeight = path0[0].Z if path0[0].Z <= path1[0].Z else path1[0].Z
    
    while (index0 < len(path0) or index1 < len(path1)):
        
        curves = []
        
        # manage first path
        points0 = []
        if index0 < len(path0):
            currentHeight = path0[index0].Z
            points0.append(rs.CreatePoint(path0[index0].X, path0[index0].Y, path0[index0].Z))
            globalIndex += 1
            index0 += 1
            
            # add the points of same height to one array
            for i in range(index0, len(path0)):
                if (path0[i].Z == points0[0].Z):
                    points0.append(rs.CreatePoint(path0[i].X, path0[i].Y, path0[i].Z))
                    index0 += 1
                    globalIndex += 1
                else:
                    break
            # close the curve by adding the first point to the end of the array and add curve0 to curves
            points0.append(points0[0])
            curve0 = rs.AddPolyline(points0)
            rs.CloseCurve(curve0)
            curves.append(curve0)
        
        #manage second path
        points1 = []
        if index1 < len(path1) and path1[index1].Z == currentHeight:
            points1.append(rs.CreatePoint(path1[index1].X, path1[index1].Y, path1[index1].Z))
            index1 += 1
            globalIndex += 1
            for i in range(index1, len(path1)):
                if (path1[i].Z == points1[0].Z):
                    points1.append(rs.CreatePoint(path1[i].X, path1[i].Y, path1[i].Z))
                    index1 += 1
                    globalIndex += 1
                else:
                    break
            points1.append(points1[0])
            curve1 = rs.AddPolyline(points1)
            rs.CloseCurve(curve1)
            curves.append(curve1)
        
        #if two curves try boolean
        if len(curves) >= 2:
            a = rs.CurveBooleanUnion(curves)
            
            if (len(a) == 1):
                rs.coercecurve(a)
                b = rg.Curve.CreateFilletCornersCurve(rs.coercecurve(a), radius, tolerance, 0.0)
                fillet.append(b)
                newCurve = sc.doc.Objects.AddCurve(b)
                points = rs.CurvePoints(newCurve)
                for i in range(0, len(points)-1):
                    path.append(rs.CreatePoint(points[i].X, points[i].Y, points[i].Z))
            else:
                for i in range(0, len(points0)):
                    path.append(rs.CreatePoint(points0[i].X, points0[i].Y, points0[i].Z))
                    
                stops.append(len(path)-1)
                stopPoints.append(path[len(path)-1])
            
                for i in range(0, len(points1)):
                    path.append(rs.CreatePoint(points1[i].X, points1[i].Y, points1[i].Z))
                
                stops.append(len(path)-1)
                stopPoints.append(path[len(path)-1])
        else:
            if index0 < len(path0):
                for i in range(0, len(points0)):
                    path.append(rs.CreatePoint(points0[i].X, points0[i].Y, points0[i].Z))
            elif index1 < len(path1):
                for i in range(0, len(points1)):
                    path.append(rs.CreatePoint(points1[i].X, points1[i].Y, points1[i].Z))
# ---------- end boolean_union ----------
fillet = ClusterOutput(boolean_union.fillet)  # fillet curves generated at the intersections of the boolean, useful to visualize where it breaks
out = ClusterOutput(boolean_union.out)  # console output
path = ClusterOutput(boolean_union.path)  # ordered array of points (point3d)
stoppoints = ClusterOutput(boolean_union.stopPoints)  # points in the final path at which a clay extrusion stop is required, stops are required when a layers is non-continuous
stops = ClusterOutput(boolean_union.stops)  # point indices at which a clay extrusion stop is required

# ==== cluster CenterPrint: Move print to center of input box.
path = ClusterInput()
domainbox = ClusterInput()

# ----
# Center print on the bed
pline = PolyLine(Vertices=path, Closed=False)
box = EvaluateBox(Box=pline, UParameter="0.5", VParameter="0.5", WParameter="0")  # -> Plane, Point, Include
box_2 = EvaluateBox(Box=domainbox, UParameter="0.5", VParameter="0.5", WParameter="0")  # -> Plane, Point, Include
vec2pt = Vector2Pt(PointA=box.Point, PointB=box_2.Point, Unitize=False)  # -> Vector, Length
move = Move(Geometry=path, Motion=vec2pt.Vector)  # -> Geometry, Transform

path_2 = ClusterOutput(move.Geometry)

# ==== cluster GCodeGenerator
nozzlediameter = ClusterInput()
printspeed = ClusterInput()
path = ClusterInput()
layerheight = ClusterInput()

# ---- group: Extrusion
pline = PolyLine(Vertices=path, Closed=False)
explode = Explode(Curve=pline, Recursive=True)  # -> Segments, Vertices
len = Length(Curve=explode.Segments)
py_extrusion = GhPythonScript(LayerHeight=layerheight, NozzleWidth=nozzlediameter, SegmentLen=len)  # -> E
# ---------- py_extrusion: Python ----------
__author__ = "mert_toka"
__version__ = "2022.04.29"

import rhinoscriptsyntax as rs
import math

# input
NozzleWidth
LayerHeight
SegmentLen

# output
E = 0

E = SegmentLen*LayerHeight/NozzleWidth * (4/math.pi + LayerHeight/NozzleWidth)
#E = (4*LayerHeight*SegmentLen*ExtrusionMultiplier) / (math.pi*NozzleWidth)
# ---------- end py_extrusion ----------
ins = InsertItems(List=py_extrusion, Item="0", Indices="0", Wrap=True)
ma = MassAddition(Input=ins)  # -> Result, PartialResults

# ---- group: XYZ
pdecon = Deconstruct(Point=path)  # -> XComponent, YComponent, ZComponent

# ---- group: Feedrate
multiplication = Multiplication(A=printspeed, B="60")
merge = Merge(Data1="10000", Data2=multiplication)  # -> flatten(Result)

# ----
lastdex = LastIndex(List=ma.PartialResults)
py_adjustext = GhPythonScript(extrusions=py_extrusion)  # -> modE; inputs extrusions: list
# ---------- py_adjustext: Python ----------
__author__ = "mert_"
__version__ = "2022.10.18"

import rhinoscriptsyntax as rs

# Input
extrusions

min = 0.8
max = 1.5

# Output
modE = []

def map(value, istart, istop, ostart, ostop):
    return ostart + (ostop - ostart) * ((value - istart) / (istop - istart))

maxIdx = len(extrusions)
midIdx = maxIdx*0.5
for i, e in enumerate(extrusions):
    modE.append(e*map(i, 0, maxIdx-1, max, min))
    
#    if i < midIdx:
#        modE.append(e*map(i, 0, midIdx, max, min))
#    else:
#        modE.append(e*map(i, midIdx, maxIdx, min, max))
# ---------- end py_adjustext ----------
item = ListItem(List=ma.PartialResults, Index=lastdex, Wrap=True)
expression = Expression(x=nozzlediameter, y=item, Expression="((x/2)^2*y)/((95.5/2)^2)/430")

# ---- group: Extrusion Multiplier for correct filament thickness
expression_2 = Expression(x=nozzlediameter, Expression="(x/1.91)^2")
multiplication_2 = Multiplication(A=ma.PartialResults, B=expression_2)

# ----
multiplication_3 = Multiplication(A=expression, B=430)
p_roundgcode = GhPythonScript(f=merge, x=pdecon.XComponent, y=pdecon.YComponent, z=pdecon.ZComponent, e=multiplication_2)  # -> f, x, y, z, e
# ---------- p_roundgcode: Python ----------
__author__ = "mert_toka"
__version__ = "2022.02.02"

import rhinoscriptsyntax as rs

_x = int(x*100)/100.0
_y = int(y*100)/100.0
_z = int(z*100)/100.0
_e = int(e*10000)/10000.0
_f = int(f*100)/100.0
# ---------- end p_roundgcode ----------
nbtubes = ClusterOutput(expression)
clayheight = ClusterOutput(multiplication_3)
concat = Concatenate(
    FragmentI="G1",
    FragmentH=" F",
    FragmentJ=p_roundgcode.f,
    FragmentA=" X",
    FragmentB=p_roundgcode.x,
    FragmentC=" Y",
    FragmentD=p_roundgcode.y,
    FragmentE=" Z",
    FragmentF=p_roundgcode.z,
    FragmentG=" E",
    FragmentK=p_roundgcode.e)  # -> flatten(Result)
panel = Panel(concat)
panel_2 = Panel(""";;; === END GCODE ===
M83 ;Set to Relative Extrusion Mode
G28 Z ;Home Z
; === DEPRESSURIZE ===
G91
G91
G1 E-1300 F4000
G90
G90""")
panel_3 = Panel(""";;; START GCODE ;;;
M82 ;absolute extrusion mode
G28 ;Home
G1 X207.5 Y202.5 Z20 F10000 ;Move X and Y to center, Z to 20mm high
G1 E2000 F20000 ; !!Prime Extruder
G92 E0
G1 F30000 E-150
;;; ======""")
merge_2 = Merge(Data1=panel_3, Data2=panel, Data3=panel_2)  # -> flatten(Result)
gcode = ClusterOutput(merge_2)

# ==== cluster Linear2D: linear 2D function y1 = a1*x1 + b1, y2 = a2*x2 + b2, where input is (x1, x2) ans output (y1, y2)
amplitudex1 = ClusterInput()  # a1, value multiplying x1
offsetx1 = ClusterInput()  # (optional) b1, value added to a1*x1
amplitudex2 = ClusterInput()  # a2, value multiplying x2
values0 = ClusterInput()
offsetx2 = ClusterInput()  # (optional) b2, value added to a2*x2
nbpoints = ClusterInput()  # number of output points (should match initialization params nbPointsInLayer for radiusShapingParameter or nbLayers for all other shaping parameters.)
mode = ClusterInput()  # (optional) ‘additive’ (default) or ‘multiplicative’ – mode determines if function operation is added to previous points or multiplied by previous points
linear2d = GhPythonScript(
    amplitudeX1=amplitudex1,
    offsetX1=offsetx1,
    amplitudeX2=amplitudex2,
    offsetX2=offsetx2,
    nbPoints=nbpoints,
    values0=values0,
    mode=mode)  # -> out, values; inputs offsetX1: list, offsetX2: list, nbPoints: Int32, values0: list of Point3d
# ---------- linear2d: Python ----------
__author__ = "sami_"
__version__ = "2022.06.28"

import rhinoscriptsyntax as rs
import math

values = []
nb = nbPoints

# check type of input for offset
offsetsX1 = []
offsetsX2 = []
for i in range(0, nb):
    if len(offsetX1) == 0:
        offsetsX1.append(0)
    elif len(offsetX1) == 1:
        offsetsX1.append(offsetX1[0])
    else:
        offsetsX1.append(offsetX1[i])
    
    if len(offsetX2) == 0:
        offsetsX2.append(offsetX2[i])
    elif len(offsetX2) == 1:
        offsetsX2.append(offsetX2[0])
    else:
        offsetsX2.append(offsetX2[i])
        
prevValues = []
for i in range(0, nb):
    if len(values0) == 0:
        prevValues.append(rs.CreatePoint(0,0))
    elif len(values0) == 1:
        prevValues.append(values0[0])
    else:
        prevValues.append(values0[i])

for i in range(0, nb):
    if mode == "additive" or mode == "":
        y1 = amplitudeX1 * i + offsetsX1[i]
        y2 = amplitudeX2 * i + offsetsX2[i]
        values.append( rs.CreatePoint(y1,y2,0) + prevValues[i])
    elif mode == "multiplicative":
        y1 = amplitudeX1 * i + offsetsX1[i]
        y2 = amplitudeX2 * i + offsetsX2[i]
        values.append( rs.CreatePoint(y1,y2,0) * prevValues[i])
# ---------- end linear2d ----------
panel = Panel(linear2d.out)
values = ClusterOutput(linear2d.values)  # y, array of point3Ds (y1, y2, 0)

# ==== cluster Sinusoidal2D: radial 2D function y1 = a1*cos(2pi/T1*x1 + b) */+ Values0.X, y2 = a2*sin(2pi/T2*x2 + b) */+ Values0.Y, where input is (x1, x2) ans output (y1, y2)
amplitudex1 = ClusterInput()  # a1, value multiplying the cosinus
periodx1 = ClusterInput()  # T1, number of points in one cycle
amplitudex2 = ClusterInput()  # a2, value multiplying the sinus
nbpoints = ClusterInput()  # number of output points (should match initialization params nbPointsInLayer for radiusShapingParameter or nbLayers for all other shaping parameters.)
periodx2 = ClusterInput()  # T2, number of points in one cycle
offset = ClusterInput()  # (optional) b, value added to the argument of the cos and the sin to offset the wave
values0 = ClusterInput()  # array of 2D floats (x1, x2) added to or multiplied by the function
mode = ClusterInput()  # (optional) ‘additive’ (default) or ‘multiplicative’ – mode determines if function operation is added to previous points or multiplied by previous points
sinusoidal2d = GhPythonScript(
    amplitudeX1=amplitudex1,
    periodX1=periodx1,
    amplitudeX2=amplitudex2,
    periodX2=periodx2,
    nbPoints=nbpoints,
    offset=offset,
    values0=values0,
    mode=mode)  # -> values; inputs nbPoints: Int32, offset: list, values0: list of Point3d
# ---------- sinusoidal2d: Python ----------
__author__ = "sami_"
__version__ = "2022.06.28"

import rhinoscriptsyntax as rs
import math

values = []
nb = nbPoints

# check type of input for offset
offsets = []
for i in range(0, nb):
    if len(offset) == 0:
        offsets.append(0)
    elif len(offset) == 1:
        offsets.append(offset[0])
    else:
        offsets.append(offset[i])
        
prevValues = []
for i in range(0, nb):
    if len(values0) == 0:
        prevValues.append(rs.CreatePoint(0,0))
    elif len(values0) == 1:
        prevValues.append(values0[0])
    else:
        prevValues.append(values0[i])


for i in range(0, nb):
    if mode == "additive" or mode == "":
        y1 = amplitudeX1*math.cos(2*math.pi*i/periodX1 + offsets[i]) + prevValues[i].X
        y2 = amplitudeX2*math.sin(2*math.pi*i/periodX2 + offsets[i]) + prevValues[i].Y
        values.append(rs.CreatePoint(y1,y2,0))
    elif mode == "multiplicative":
        y1 = amplitudex1*math.cos(2*math.pi*i/periodX1 + offsets[i]) * prevValues[i].X
        y2 = amplitudeX2*math.sin(2*math.pi*i/periodX2 + offsets[i]) * prevValues[i].Y
        values.append(rs.CreatePoint(y1,y2,0))
# ---------- end sinusoidal2d ----------
values = ClusterOutput(sinusoidal2d)  # y, array of point3Ds (y1, y2, 0)

# ==== cluster Sinusoidal2D_2: radial 2D function y1 = a1*cos(2pi/T1*x1 + b) */+ Values0.X, y2 = a2*sin(2pi/T2*x2 + b) */+ Values0.Y, where input is (x1, x2) and output (y1, y2)
periodx2 = ClusterInput()  # T2, number of points in one cycle
values0 = ClusterInput()  # array of 2D floats (x1, x2) added to or multiplied by the function
nbpoints = ClusterInput()  # number of output points (should match initialization params nbPointsInLayer for radiusShapingParameter or nbLayers for all other shaping parameters.)
offset = ClusterInput()  # (optional) b, value added to the argument of the cos and the sin to offset the wave
amplitudex1 = ClusterInput()  # a1, value multiplying the cosinus
periodx1 = ClusterInput()  # T1, number of points in one cycle
amplitudex2 = ClusterInput()  # a2, value multiplying the sinus
mode = ClusterInput()  # (optional) ‘additive’ (default) or ‘multiplicative’ – mode determines if function operation is added to previous points or multiplied by previous points
sinusoidal2d = GhPythonScript(
    amplitudeX1=amplitudex1,
    periodX1=periodx1,
    amplitudeX2=amplitudex2,
    periodX2=periodx2,
    nbPoints=nbpoints,
    offset=offset,
    values0=values0,
    mode=mode)  # -> values; inputs nbPoints: Int32, offset: list, values0: list of Point3d; same code as sinusoidal2d
values = ClusterOutput(sinusoidal2d)  # y, array of point3Ds (y1, y2, 0)

# ==== cluster Linear2D_2: linear 2D function y1 = a1*x1 + b1, y2 = a2*x2 + b2, where input is (x1, x2) and output (y1, y2)
amplitudex1 = ClusterInput()  # a1, value multiplying x1
values0 = ClusterInput()  # (optional) array of 2D floats (x1, x2) added to or multiplied by the function
offsetx1 = ClusterInput()  # (optional) b1, value added to a1*x1
amplitudex2 = ClusterInput()  # a2, value multiplying x2
offsetx2 = ClusterInput()  # (optional) b2, value added to a2*x2
nbpoints = ClusterInput()  # number of output points (should match initialization params nbPointsInLayer for radiusShapingParameter or nbLayers for all other shaping parameters.)
mode = ClusterInput()  # (optional) ‘additive’ (default) or ‘multiplicative’ – mode determines if function operation is added to previous points or multiplied by previous points
linear2d = GhPythonScript(
    amplitudeX1=amplitudex1,
    offsetX1=offsetx1,
    amplitudeX2=amplitudex2,
    offsetX2=offsetx2,
    nbPoints=nbpoints,
    values0=values0,
    mode=mode)  # -> values; inputs offsetX1: list, offsetX2: list, nbPoints: Int32, values0: list of Point3d; same code as linear2d
values = ClusterOutput(linear2d)  # y, array of point3Ds (y1, y2, 0)
